# Dynamo graph Generate Sample Data.dyn (Dynamo 2.1.0.7500)

# group: Import CSVs
folder_path = StringInput("C:\Users\elsdonl0213\Repos\BinocularsSampleData\Import\")
code_block = CodeBlock(path=folder_path) { path + "Names and Locations.csv"; }
importCSV = Data.ImportCSV(filePath=code_block)
code_block_2 = CodeBlock { 0; }
removeItemAtIndex = List.RemoveItemAtIndex(list=importCSV@L2, indices=code_block_2)
code_block_3 = CodeBlock(path=folder_path) { path + "AWS Data Centers.csv"; }
importCSV_2 = Data.ImportCSV(filePath=code_block_3)
code_block_4 = CodeBlock(path=folder_path) { path + "Example Graph Names.csv"; }
importCSV_3 = Data.ImportCSV(filePath=code_block_4)
code_block_5 = CodeBlock(path=folder_path) { path + "Example Packages.csv"; }
importCSV_4 = Data.ImportCSV(filePath=code_block_5)

# group: Start with 100 users. Create or falsify their local environment data.
py = CodeBlock()  # "randomPackakge.py"
# ---------- py.designscript (27 lines) ----------
"
import random

#The inputs to this node will be stored as a list in the IN variables.
dataEnteringNode = IN

data = IN[0]
packages = IN[1][0]

result = []
i = 0

package_count = len(packages)

for row in data:
	num = random.sample(range(0, package_count - 1), random.randint(1,5))
	r = ''
	for n in num:
		r += ',' + packages[n]
	r = '\"' + r[1:] + '\"'
	row.append(r)
	result.append(row)
	i = i + 1

#Assign your output to the OUT variable.
OUT = result
";
# ----------------------------------------
py_2 = CodeBlock()  # "randomPackage.py"
# ---------- py_2.designscript (26 lines) ----------
"
import random

#The inputs to this node will be stored as a list in the IN variables.
dataEnteringNode = IN

data = IN[0]
ips = IN[1][0]
cities = IN[1][1]
countries = IN[1][2]

result = []
i = 0

package_count = len(ips)

for row in data:
	num = random.randint(0, package_count - 1)
	r = ips[num] + ',' + cities[num] + ',' + countries[num]
	row.append(r)
	result.append(row)
	i = i + 1

#Assign your output to the OUT variable.
OUT = result
";
# ----------------------------------------
py_3 = CodeBlock()  # "randmSemVar.py"
# ---------- py_3.designscript (20 lines) ----------
"
import random

#The inputs to this node will be stored as a list in the IN variables.
dataEnteringNode = IN

data = IN[0]

result = []
i = 0

for row in data:
	semvar = str(random.randint(2016,2019)) + '.' + str(random.randint(0,9)) + '.' + str(random.randint(0,9))
	row.append(semvar)
	result.append(row)
	i = i + 1

#Assign your output to the OUT variable.
OUT = result
";
# ----------------------------------------
py_4 = CodeBlock()  # "RandomSemVar.py"
# ---------- py_4.designscript (20 lines) ----------
"
import random

#The inputs to this node will be stored as a list in the IN variables.
dataEnteringNode = IN

data = IN[0]

result = []
i = 0

for row in data:
	semvar = str(random.randint(1,2)) + '.0.' + str(random.randint(0,1))
	row.append(semvar)
	result.append(row)
	i = i + 1

#Assign your output to the OUT variable.
OUT = result
";
# ----------------------------------------
code_block_6 = CodeBlock(randomDataCSV=removeItemAtIndex, dataCenters=importCSV_2, graphnames=importCSV_3, packages=importCSV_4) { randomDataCSV; dataCenters; graphnames; packages; }
code_block_7 = CodeBlock(randomDataCSV=code_block_6.randomDataCSV, dataCenters=code_block_6.dataCenters, graphnames=code_block_6.graphnames, packages=code_block_6.packages) { randomDataCSV; dataCenters; graphnames; packages; }
combine_lat_lng = CodeBlock(randomDataCSV=code_block_7.randomDataCSV) { randomDataCSV[2]+ "," + randomDataCSV[3]; }
computer_name_py = CodeBlock()
# ---------- computer_name_py.designscript (22 lines) ----------
"
import random

#The inputs to this node will be stored as a list in the IN variables.
dataEnteringNode = IN

data = IN[0]
first_names = IN[1][1]

result = []
i = 0

for row in data:
	first = first_names[i].upper();
	first_reversed = first[::-1]
	row.append(first_reversed)
	result.append(row)
	i = i + 1

#Assign your output to the OUT variable.
OUT = result
";
# ----------------------------------------
py_5 = CodeBlock()  # "FormatUsername.py"
# ---------- py_5.designscript (24 lines) ----------
"
import random

#The inputs to this node will be stored as a list in the IN variables.
dataEnteringNode = IN

last_names = IN[0][0]
first_names = IN[0][1]

result = []
i = 0

for last in last_names:
	name = last
	name += first_names[i][0:1]
	name += str(random.randint(100,999))
	row = []
	row.append(name)
	result.append(row)
	i = i + 1

#Assign your output to the OUT variable.
OUT = result;
";
# ----------------------------------------
# note: USERNAME
python_script_from_string = PythonStringNode(script=py_5, IN[0]=code_block_6.randomDataCSV)
# note: COMPUTER NAME
python_script_from_string_2 = PythonStringNode(script=computer_name_py, IN[0]=python_script_from_string, IN[1]=code_block_6.randomDataCSV)
# note: LAT,LNG
addItemToEnd = List.AddItemToEnd(item=combine_lat_lng, list=python_script_from_string_2@L2, lacing=Shortest)
# note: DYNAMO VERSION
python_script_from_string_3 = PythonStringNode(script=py_4, IN[0]=addItemToEnd, IN[1]=code_block_7.randomDataCSV)
code_block_8 = CodeBlock(randomDataCSV=code_block_7.randomDataCSV, dataCenters=code_block_7.dataCenters, graphnames=code_block_7.graphnames, packages=code_block_7.packages) { randomDataCSV; dataCenters; graphnames; packages; }
# note: REVIT VERSION
python_script_from_string_4 = PythonStringNode(script=py_3, IN[0]=python_script_from_string_3, IN[1]=code_block_8.randomDataCSV)
# note: IPs, CITIES, COUNTRIES
python_script_from_string_5 = PythonStringNode(script=py_2, IN[0]=python_script_from_string_4, IN[1]=code_block_8.dataCenters)
# note: PACKAGES INSTALLED
python_script_from_string_6 = PythonStringNode(script=py, IN[0]=python_script_from_string_5, IN[1]=code_block_8.randomDataCSV)

# group: Repeat by Random Number of Runs
py_6 = CodeBlock()  # "randInt.py"
# ---------- py_6.designscript (19 lines) ----------
"
import random

#The inputs to this node will be stored as a list in the IN variables.
dataEnteringNode = IN

data = IN[0]

result = []
i = 0

for row in data:
	num_runs = random.randint(1,30)
	result.append(num_runs)
	i = i + 1

#Assign your output to the OUT variable.
OUT = result
";
# ----------------------------------------
# note: NUMBER OF RUNS
python_script_from_string_7 = PythonStringNode(script=py_6, IN[0]=python_script_from_string_6)
ofRepeatedItem = List.OfRepeatedItem(item=python_script_from_string_6, amount=python_script_from_string_7, lacing=Shortest)
code_block_9 = CodeBlock { 1; }
flatten = List.Flatten(list=ofRepeatedItem, amt=code_block_9)

# group: Start with 20 graphs. Create or falsify data for them.
py_7 = CodeBlock()  # "randomPackages.py"
# ---------- py_7.designscript (27 lines) ----------
"
import random

#The inputs to this node will be stored as a list in the IN variables.
dataEnteringNode = IN

data = IN[0]
packages = IN[1][0]

result = []
i = 0

package_count = len(packages)

for row in data:
	num = random.sample(range(0, package_count - 1), random.randint(1,2))
	r = ''
	for n in num:
		r += ',' + packages[n]
	r = '\"' + r[1:] + '\"'
	row.append(r)
	result.append(row)
	i = i + 1

#Assign your output to the OUT variable.
OUT = result
";
# ----------------------------------------
py_8 = CodeBlock()  # "randomSemVar.py"
# ---------- py_8.designscript (20 lines) ----------
"
import random

#The inputs to this node will be stored as a list in the IN variables.
dataEnteringNode = IN

data = IN[0]

result = []
i = 0

for row in data:
	semvar = str(random.randint(0,1)) + '.' + str(random.randint(0,9)) + '.' + str(random.randint(0,9))
	row.append(semvar)
	result.append(row)
	i = i + 1

#Assign your output to the OUT variable.
OUT = result
";
# ----------------------------------------
py_9 = CodeBlock()  # "FormatUsername.py"
# ---------- py_9.designscript (20 lines) ----------
"
import random

#The inputs to this node will be stored as a list in the IN variables.
dataEnteringNode = IN

data = IN[0][0]

result = []
i = 0

for r in data:
	row = []
	row.append(r)
	result.append(row)
	i = i + 1

#Assign your output to the OUT variable.
OUT = result;
";
# ----------------------------------------
code_block_10 = CodeBlock(graphnames=importCSV_3, packages=importCSV_4) { graphnames; packages; }
# note: GRAPH NAME
python_script_from_string_8 = PythonStringNode(script=py_9, IN[0]=code_block_10.graphnames)
# note: GRAPH VERSION
python_script_from_string_9 = PythonStringNode(script=py_8, IN[0]=python_script_from_string_8)

code_block_11 = CodeBlock(graphnames=code_block_10.graphnames, packages=code_block_10.packages) { graphnames; packages; }

# group (continued): Start with 20 graphs. Create or falsify data for them.
# note: PACKAGES REQURIED
python_script_from_string_10 = PythonStringNode(script=py_7, IN[0]=python_script_from_string_9, IN[1]=code_block_11.packages)

# group: Add a Graph Name + Version to each run
py_10 = CodeBlock()  # "randInt.py"
# ---------- py_10.designscript (27 lines) ----------
"
import random

#The inputs to this node will be stored as a list in the IN variables.
dataEnteringNode = IN

data = IN[0]
filenames = IN[1][0]
semvar = IN[1][1]
required_packages = IN[1][2]

result = []
i = 0

graph_count = len(filenames)

for row in data:
	num = random.randint(0, graph_count - 1)
	row.append(filenames[num])
	row.append(semvar[num])
	row.append(required_packages[num])
	result.append(row)
	i = i + 1

#Assign your output to the OUT variable.
OUT = result
";
# ----------------------------------------
transpose = List.Transpose(lists=python_script_from_string_10)
python_script_from_string_11 = PythonStringNode(script=py_10, IN[0]=flatten, IN[1]=transpose)

# group: Add unique data to each run
py_11 = CodeBlock()  # "randDatetime.py"
# ---------- py_11.designscript (20 lines) ----------
"
import random
#The inputs to this node will be stored as a list in the IN variables.
dataEnteringNode = IN

data = IN[0]
currentdate = 1554475004779
result = []
i = 0

for row in data:
	ms = str(random.randint(currentdate - (2629800000 * 2) , currentdate))
	row.append(ms)
	result.append(row)
	i = i + 1

#Assign your output to the OUT variable.
OUT = result

";
# ----------------------------------------
py_12 = CodeBlock()  # "randMS.py"
# ---------- py_12.designscript (19 lines) ----------
"
import random

#The inputs to this node will be stored as a list in the IN variables.
dataEnteringNode = IN

data = IN[0]
result = []
i = 0

for row in data:
	ms = str(random.randint(3600000 * 0.25, 3600000 * 2))
	row.append(ms)
	result.append(row)
	i = i + 1

#Assign your output to the OUT variable.
OUT = result
";
# ----------------------------------------
py_13 = CodeBlock()  # "randMS.py"
# ---------- py_13.designscript (20 lines) ----------
"
import random

#The inputs to this node will be stored as a list in the IN variables.
dataEnteringNode = IN

data = IN[0]
result = []
i = 0

for row in data:
	ms = str(random.randint(100,999))
	row.append(ms)
	result.append(row)
	i = i + 1

#Assign your output to the OUT variable.
OUT = result

";
# ----------------------------------------
# note: EXECUTION TIME
python_script_from_string_12 = PythonStringNode(script=py_13, IN[0]=python_script_from_string_11)
# note: TIME SAVED
python_script_from_string_13 = PythonStringNode(script=py_12, IN[0]=python_script_from_string_12)
# note: DATETIME
python_script_from_string_14 = PythonStringNode(script=py_11, IN[0]=python_script_from_string_13)

# group: Add header row
code_block_12 = CodeBlock { "Username,Computer,Lat,Lng,Dynamo Version,Revit Version,IP,City,Country,Packages Installed,Graph Name,Graph Version,Graph Packages,Execution Time,Time Saved,Datetime"; }
addItemToFront = List.AddItemToFront(item=code_block_12, list=python_script_from_string_14)

# group: Output to CSV
folder_path_2 = StringInput("C:\Users\elsdonl0213\Repos\BinocularsSampleData\Export\")
code_block_13 = CodeBlock(path=folder_path_2) { path + "Sample Data.csv"; }
# note: PLEASE NOTE
# I'm taking advantage of the fact Data.ExportCSV doesn't correctly escape commas:
# https://xkcd.com/1172/
code_block_14 = CodeBlock(output=addItemToFront) { output; }
exportCSV = Data.ExportCSV(filePath=code_block_13, data=code_block_14)  # frozen
count = List.Count(list=code_block_14)
watch = Watch(code_block_14)
